# Requirement set Electram Requirements (R2025b)

## 1 [Part 23 Requirements]

### 1.1 [Climb Gradients]

#### 1.1.1 [OEI Climb Gradient] > 2%

#### 1.1.2 [23.2120: AEO Climb Gradient] > 4%
2 percent climb gradient at 400 feet (122 meters) above the takeoff surface with the landing gear retracted and flaps in the approach configuration(s).

### 1.2 [Weight] MTOW < 19,000 lbs

## 2 [Performance Requirements] Measure of Merit Requirements

### 2.1 [Passenger Count] 19 Passengers
Aircraft shall have 19 passengers.

### 2.2 [Range] Range > 300 nm

### 2.3 [Takeoff] Takeoff Distance < 2600 ft

### 2.4 [Landing] Landing Distance < 2600 ft

### 2.5 [Endurance] 45 min fuel reserves

### 2.6 [Air Stair] Door Stair

## 3 [RFP] RFP Requirements

### 3.1 [EIS] 2035 (Systems certifiable by 2034)

### 3.2 [TO/LD Distance] Less than 4000 ft

### 3.3 [Passenger Capacity] Greater than 9
Passenger count shall be greater than 9

### 3.4 [Wingspan Limit] < 36 m

### 3.5 [Range] Range > 300 nm

### 3.6 [Propulsion] Multi-engine Configuration

### 3.7 [Reliability] ≥ current equivalent aircraft
Multiengine configuration (tip and BLI)

### 3.8 [Noise] FAR Part 36 §36.301(c) compliant
Max propeller tip speed is less than 0.9 Mach

### 3.9 [Maintenance Cost] Lower than current equivalents
Annual cost is less than $4.4 million